# Grasshopper definition a2.gh (Grasshopper 1.0.7)

number_of_sides = Slider(8, range=0..10)
size = Slider(11, range=5..20)
number_of_sides_2 = Slider(5, range=0..10)
size_2 = Slider(8, range=5..20)
depth = Slider(3.012, range=1..5)
gap_width = Slider(2.163, range=0..4)
point = Point(<point referenced from the Rhino model>)
gap_width_2 = Slider(2.163, range=0..4)
depth_2 = Slider(2.058, range=1..5)
point_2 = Point(<point referenced from the Rhino model>)
polygon = Polygon(Plane=point, Radius=size, Segments=number_of_sides, FilletRadius=0)  # -> Polygon, Length
polygon_2 = Polygon(Plane=point_2, Radius=size_2, Segments=number_of_sides_2, FilletRadius=0)  # -> Polygon, Length
deconstruct_brep = DeconstructBrep(Brep=polygon.Polygon)  # -> Faces, Edges, Vertices
deconstruct_brep_2 = DeconstructBrep(Brep=polygon_2.Polygon)  # -> Faces, Edges, Vertices
curve = Curve(deconstruct_brep.Edges)
curve_middle = CurveMiddle(Curve=deconstruct_brep.Edges)
curve_2 = Curve(deconstruct_brep_2.Edges)
curve_middle_2 = CurveMiddle(Curve=deconstruct_brep_2.Edges)
length = Length(Curve=deconstruct_brep.Edges)
division = Division(A=gap_width, B=length)
addition = Addition(A=depth, B=Slider(1, range=0..1))
length_2 = Length(Curve=deconstruct_brep_2.Edges)
division_2 = Division(A=gap_width_2, B=length_2)
boolean_toggle = BooleanToggle(True)
scale = Scale(Geometry=curve, Center=curve_middle, Factor=division)  # -> Geometry, Transform
boolean_toggle_2 = BooleanToggle(True)
vector_2pt = Vector2Pt(PointA=curve_middle, PointB=point, Unitize=boolean_toggle)  # -> Vector, Length
vector_2pt_2 = Vector2Pt(PointA=point, PointB=curve_middle, Unitize=boolean_toggle)  # -> Vector, Length
length_3 = Length(Curve=scale.Geometry)
scale_2 = Scale(Geometry=curve_2, Center=curve_middle_2, Factor=division_2)  # -> Geometry, Transform
addition_2 = Addition(A=depth_2, B=Slider(1, range=0..1))
amplitude = Amplitude(Vector=vector_2pt.Vector, Amplitude=addition)
extrude = Extrude(Base=scale.Geometry, Direction=amplitude)
vector_2pt_3 = Vector2Pt(PointA=curve_middle_2, PointB=point_2, Unitize=boolean_toggle_2)  # -> Vector, Length
vector_2pt_4 = Vector2Pt(PointA=point_2, PointB=curve_middle_2, Unitize=boolean_toggle_2)  # -> Vector, Length
move = Move(Geometry=extrude, Motion=vector_2pt_2.Vector)  # -> Geometry, Transform
length_4 = Length(Curve=scale_2.Geometry)
curve_3 = Curve(polygon.Polygon)
amplitude_2 = Amplitude(Vector=vector_2pt_3.Vector, Amplitude=addition_2)
extrude_2 = Extrude(Base=scale_2.Geometry, Direction=amplitude_2)
move_2 = Move(Geometry=extrude_2, Motion=vector_2pt_4.Vector)  # -> Geometry, Transform
trim_with_regions = TrimWithRegions(Curve=curve_3, Regions=move.Geometry)  # -> Inside, Outside
curve_4 = Curve(polygon_2.Polygon)
trim_with_regions_2 = TrimWithRegions(Curve=move.Geometry, Regions=curve_3)  # -> Inside, Outside
curve_5 = Curve(flatten(trim_with_regions.Outside))
curve_6 = Curve(trim_with_regions.Inside)
curve_7 = Curve(flatten(trim_with_regions_2.Inside))
curve_8 = Curve(trim_with_regions_2.Outside)
trim_with_regions_3 = TrimWithRegions(Curve=curve_4, Regions=move_2.Geometry)  # -> Inside, Outside
join_curves = JoinCurves(Curves=[curve_5, curve_7], Preserve=False)
trim_with_regions_4 = TrimWithRegions(Curve=move_2.Geometry, Regions=curve_4)  # -> Inside, Outside
curve_9 = Curve(flatten(trim_with_regions_3.Outside))
curve_10 = Curve(trim_with_regions_3.Inside)
curve_11 = Curve(flatten(trim_with_regions_4.Inside))
curve_12 = Curve(trim_with_regions_4.Outside)
join_curves_2 = JoinCurves(Curves=[curve_9, curve_11], Preserve=False)
panel = Panel(join_curves_2)
